# Grasshopper definition anillo.gh (Grasshopper 0.9.76)

pt = ConstructPoint(XCoordinate=Slider(7, range=0..20), YCoordinate=Slider(8, range=0..20), ZCoordinate=0)
pt_2 = ConstructPoint(XCoordinate=Slider(-7, range=-10..20), YCoordinate=Slider(0, range=-10..20), ZCoordinate=0)
rec_2pt = Rectangle2Pt(Plane=PlaneXY(0, 0, 0), PointA=pt_2, PointB=pt, Radius=0)  # -> Rectangle, Length
Z = UnitZ(Factor=Slider(0.5, range=0..20))

Z_2 = UnitZ(Factor=Slider(0.5, range=0..20))
cir = Circle(Plane=PlaneXY(0, 0, 0), Radius=Slider(7, range=0..20))

Z_3 = UnitZ(Factor=Slider(0.5, range=0..20))
cir_2 = Circle(Plane=PlaneXY(0, 0, 0), Radius=Slider(6, range=0..20))

geo = Geometry(<curve referenced from the Rhino model>)
rdiff = RegionDifference(CurvesA=cir, CurvesB=cir_2)
rdiff_2 = RegionDifference(CurvesA=rec_2pt.Rectangle, CurvesB=cir)
boundary = BoundarySurfaces(Edges=[rdiff, rdiff_2])
